# Grasshopper definition randomDiamonds.ghx (Grasshopper 1.0.7)
# plug-ins: Wombat, Weaverbird, LunchBox, Pufferfish

mesh = Mesh(<mesh referenced from the Rhino model>)
srfu = GetInteger("4", AtLeast=1, AtMost=50, Maximum=2147483647, Minimum=-2147483648, TreeAccess=False)
rr_a = GetNumber(Slider(0.77, range=0..15), AtLeast=1, AtMost=100, Maximum=1.797693135e+308, Minimum=-1.797693135e+308, TreeAccess=False)
srfv = GetInteger("4", AtLeast=1, AtMost=100, Maximum=2147483647, Minimum=-2147483648, TreeAccess=False)
basemesh = GetGeometry(mesh, AtLeast=1, AtMost=1, DeleteInput=False, Filter=1073741856, TreeAccess=False)
rr_b = GetNumber(
    Slider(54.27, range=0..105),
    AtLeast=1,
    AtMost=100,
    Maximum=1.797693135e+308,
    Minimum=-1.797693135e+308,
    TreeAccess=False)
wbfacepolys = WeaverbirdsFacePolylines(Mesh=basemesh)  # -> graft(Polygons)
explode = Explode(Curve=wbfacepolys, Recursive=True)  # -> simplify(Segments), Vertices
len = Length(Curve=explode.Segments)
sort = SortList(Keys=len, ValuesA=explode.Segments)  # -> Keys, reverse(ValuesA)
item = ListItem(List=sort.ValuesA, Index=0, Wrap=True)  # -> Item, Item1
loft = Loft(
    Curves=[item.Item, item.Item1],
    Options={Adjust=True, Closed=False, LoftEnds=0, LoftSimp=0, LoftType=0, Rebuild=10, Refit=0.01})
join = BrepJoin(Breps=loft)  # -> Breps, Closed
fbd = BrepFacesByDirection(Brep=join.Breps, Tolerance=0.9)  # -> Top, Bottom, Sides
srf = Surface(flatten(fbd.Sides))
flip = Flip(Surface=srf)  # -> Surface, Result
diamond = DiamondPanels(Surface=flip.Surface, UDivisions=srfu, VDivisions=srfv)  # -> DiamondPanels, TriPanels
wires = BrepWireframe(Brep=diamond.DiamondPanels, Density=-1)
wires_2 = BrepWireframe(Brep=diamond.TriPanels, Density=-1)
end = EndPoints(Curve=wires)  # -> simplify(Start), End
end_2 = EndPoints(Curve=wires_2)  # -> simplify(Start), End
triangle = MeshTriangle(CornerA=0, CornerB=1, CornerC=2)
quad = MeshQuad(CornerA=0, CornerB=1, CornerC=2, CornerD=3)
conmesh = ConstructMesh(Vertices=simplify(end_2.Start), Faces=triangle)  # -> flatten(Mesh)
conmesh_2 = ConstructMesh(Vertices=simplify(end.Start), Faces=quad)  # -> flatten(Mesh)
merge = Merge(Data1=conmesh_2, Data2=conmesh)
dom = ConstructDomain(DomainStart=rr_a, DomainEnd=rr_b)
lng = ListLength(List=merge)
random = Random(Range=dom, Number=lng, Seed=2)
offmsh = OffsetMesh(Mesh=merge, Distance=expr("-x", random), BothSides=0, CreateSolid=True)

# ---- group: RH_OUT:panels
mesh_2 = Mesh(flatten(offmsh))
